# Dynamo graph AnchorBolts.dyn "AnchorBolts_Rectangular" (Dynamo 2.5.2.7915)

code_block = CodeBlock()
# ---------- code_block.designscript (3 lines) ----------
CoordinateSystem.ByOriginVectors(Point.Origin(), Vector.XAxis(), Vector.YAxis(), Vector.ZAxis());
Point.Origin();
Vector.ZAxis();
# ----------------------------------------
byOriginNormal = Plane.ByOriginNormal(origin=code_block.out1, normal=code_block.out2)
code_block_2 = CodeBlock { 300; 300; }
byWidthLength = Rectangle.ByWidthLength(plane=byOriginNormal, width=code_block_2.out0, length=code_block_2.out1)
code_block_3 = CodeBlock { 500; 650; 20; 0; -1; 1; }
byRectanglarByCS = AdvanceSteel.Nodes.Plates.Plate.ByRectanglarByCS(coordinateSystem=code_block.out0, length=code_block_3.out0, width=code_block_3.out1, thickness=code_block_3.out2, side=code_block_3.out3, corner=code_block_3.out4)
byRectanglarByCS_2 = AdvanceSteel.Nodes.Plates.Plate.ByRectanglarByCS(coordinateSystem=code_block.out0, length=code_block_3.out0, width=code_block_3.out1, thickness=code_block_3.out2, side=code_block_3.out5, corner=code_block_3.out4)
list_create = List.Create(item0=byRectanglarByCS, item1=byRectanglarByCS_2)
code_block_4 = CodeBlock { "MuS"; "4.6"; "HOLDING DOWN BOLTS"; 300; }
code_block_5 = CodeBlock { 20; 2; 2; }
anchorBolts = AdvanceSteel.Nodes.Util.BuildPropertyCollection.AnchorBolts(standard=code_block_4.out2, boltAssembly=code_block_4.out0, grade=code_block_4.out1, anchorLength=code_block_4.out3, diameter=code_block_5.out0, xHoleCount=code_block_5.out1, yHoleCount=code_block_5.out2)
byRectangle = AdvanceSteel.Nodes.ConnectionObjects.Anchors.RectangularAnchorPattern.ByRectangle(rectangle=byWidthLength, objectsToConnect=list_create, anchorBoltData=anchorBolts)
code_block_6 = CodeBlock()
# ---------- code_block_6.designscript (3 lines) ----------
CoordinateSystem.ByOriginVectors(Point.ByCoordinates(1500,0,0), Vector.XAxis(), Vector.YAxis(), Vector.ZAxis());
Point.ByCoordinates(1500,0,0);
Vector.ZAxis();
# ----------------------------------------
byOriginNormal_2 = Plane.ByOriginNormal(origin=code_block_6.out1, normal=code_block_6.out2)
code_block_7 = CodeBlock { 300; 300; }
byWidthLength_2 = Rectangle.ByWidthLength(plane=byOriginNormal_2, width=code_block_7.out0, length=code_block_7.out1)
code_block_8 = CodeBlock { 500; 650; 20; 0; -1; 1; }
byRectanglarByCS_3 = AdvanceSteel.Nodes.Plates.Plate.ByRectanglarByCS(coordinateSystem=code_block_6.out0, length=code_block_8.out0, width=code_block_8.out1, thickness=code_block_8.out2, side=code_block_8.out3, corner=code_block_8.out4)
byRectanglarByCS_4 = AdvanceSteel.Nodes.Plates.Plate.ByRectanglarByCS(coordinateSystem=code_block_6.out0, length=code_block_8.out0, width=code_block_8.out1, thickness=code_block_8.out2, side=code_block_8.out5, corner=code_block_8.out4)
list_create_2 = List.Create(item0=byRectanglarByCS_3, item1=byRectanglarByCS_4)
code_block_9 = CodeBlock { "MuS"; "4.6"; "HOLDING DOWN BOLTS"; 300; }
code_block_10 = CodeBlock { 20; 3; 4; 150; 200; }
anchorBolts_2 = AdvanceSteel.Nodes.Util.BuildPropertyCollection.AnchorBolts(standard=code_block_9.out2, boltAssembly=code_block_9.out0, grade=code_block_9.out1, anchorLength=code_block_9.out3, diameter=code_block_10.out0, xHoleCount=code_block_10.out1, yHoleCount=code_block_10.out2, xHoleSpacing=code_block_10.out3, yHoleSpacing=code_block_10.out4)
atCentrePoint = AdvanceSteel.Nodes.ConnectionObjects.Anchors.RectangularAnchorPattern.AtCentrePoint(connectionPoint=code_block_6.out1, boltCS=code_block_6.out0, objectsToConnect=list_create_2, anchorBoltData=anchorBolts_2)
code_block_11 = CodeBlock { Point.ByCoordinates(1500,1500,0); 600; Vector.ZAxis(); 1500; 20; 0; 1; -1; }
byCenterPointRadius = Circle.ByCenterPointRadius(centerPoint=code_block_11.out0, radius=code_block_11.out1)
code_block_12 = CodeBlock { Vector.XAxis(); }
byRectanglarByPointandNormal = AdvanceSteel.Nodes.Plates.Plate.ByRectanglarByPointandNormal(origin=code_block_11.out0, normal=code_block_11.out2, length=code_block_11.out3, width=code_block_11.out3, thickness=code_block_11.out4, side=code_block_11.out5, corner=code_block_11.out7)
byRectanglarByPointandNormal_2 = AdvanceSteel.Nodes.Plates.Plate.ByRectanglarByPointandNormal(origin=code_block_11.out0, normal=code_block_11.out2, length=code_block_11.out3, width=code_block_11.out3, thickness=code_block_11.out4, side=code_block_11.out6, corner=code_block_11.out7)
list_create_3 = List.Create(item0=byRectanglarByPointandNormal, item1=byRectanglarByPointandNormal_2)
code_block_13 = CodeBlock { "MuS"; "4.6"; "HOLDING DOWN BOLTS"; 300; }
code_block_14 = CodeBlock { 20; 7; 300; }
bolt_connection_type = BoltConnectionType("InShop")
anchor_orientation_type = AnchorOrientationType("Diagonal Outside")
code_block_15 = CodeBlock { false; }
anchorBolts_3 = AdvanceSteel.Nodes.Util.BuildPropertyCollection.AnchorBolts(standard=code_block_13.out2, boltAssembly=code_block_13.out0, grade=code_block_13.out1, anchorLength=code_block_13.out3, diameter=code_block_14.out0, xHoleCount=code_block_14.out1, radius=code_block_14.out2, anchorBoltConType=bolt_connection_type, anchorBoltOrientation=anchor_orientation_type, anchorBoltInverted=code_block_15)
byCircle = AdvanceSteel.Nodes.ConnectionObjects.Anchors.CircularAnchorPattern.ByCircle(circle=byCenterPointRadius, referenceVector=code_block_12, objectsToConnect=list_create_3, anchorBoltData=anchorBolts_3)
