# Dynamo graph Beams.dyn (Dynamo 1.2.0.3015)

code_block = CodeBlock { Point.ByCoordinates(0,0,0); Point.ByCoordinates(2000,2000,2000); Vector.ZAxis(); }
byStartPointEndPoint = AdvanceSteel.Nodes.Beams.TaperedBeam.ByStartPointEndPoint(code_block.out0, code_block.out1, code_block.out2)
code_block_2 = CodeBlock { "TaperedBeam"; "Default"; }
createSectionString = AdvanceSteel.Nodes.Util.BeamSection.CreateSectionString(code_block_2.out0, code_block_2.out1)
setSection = AdvanceSteel.Nodes.Util.BeamSection.SetSection(byStartPointEndPoint, createSectionString)
code_block_3 = CodeBlock { Point.ByCoordinates(0,0,0); Point.ByCoordinates(0,2000,2000); Vector.ZAxis(); }
code_block_4 = CodeBlock { "Compound2UToe"; "Default CISC"; "Default"; }
createSectionString_2 = AdvanceSteel.Nodes.Util.BeamSection.CreateSectionString(code_block_4.out0, code_block_4.out1)
byStartPointEndPoint_2 = AdvanceSteel.Nodes.Beams.CompoundBeam.ByStartPointEndPoint(code_block_3.out0, code_block_3.out1, code_block_3.out2, createSectionString_2)
createSectionString_3 = AdvanceSteel.Nodes.Util.BeamSection.CreateSectionString(code_block_4.out0, code_block_4.out2)
setSection_2 = AdvanceSteel.Nodes.Util.BeamSection.SetSection(byStartPointEndPoint_2, createSectionString_3)
code_block_5 = CodeBlock { Point.ByCoordinates(0,0,0); Point.ByCoordinates(2000,0,0); Vector.ZAxis(); }
code_block_6 = CodeBlock { "WeldedHalfColumn"; "Default"; }
createSectionString_4 = AdvanceSteel.Nodes.Util.BeamSection.CreateSectionString(code_block_6.out0, code_block_6.out1)
byStartPointEndPoint_3 = AdvanceSteel.Nodes.Beams.CompoundBeam.ByStartPointEndPoint(code_block_5.out0, code_block_5.out1, code_block_5.out2, createSectionString_4)
code_block_7 = CodeBlock { "WeldedHollow"; "Default"; }
createSectionString_5 = AdvanceSteel.Nodes.Util.BeamSection.CreateSectionString(code_block_7.out0, code_block_7.out1)
setSection_3 = AdvanceSteel.Nodes.Util.BeamSection.SetSection(byStartPointEndPoint_3, createSectionString_5)
code_block_8 = CodeBlock { Point.ByCoordinates(0,0,0); Point.ByCoordinates(1000,1200,0); Point.ByCoordinates(2000,2000,0); Vector.ZAxis(); }
byStartPointEndPoint_4 = AdvanceSteel.Nodes.Beams.BentBeam.ByStartPointEndPoint(code_block_8.out0, code_block_8.out2, code_block_8.out1, code_block_8.out3)
code_block_9 = CodeBlock { "Lindab Z Profiles"; "ZUni 35030"; }
createSectionString_6 = AdvanceSteel.Nodes.Util.BeamSection.CreateSectionString(code_block_9.out0, code_block_9.out1)
setSection_4 = AdvanceSteel.Nodes.Util.BeamSection.SetSection(byStartPointEndPoint_4, createSectionString_6)
code_block_10 = CodeBlock { Point.ByCoordinates(0,0,0); Point.ByCoordinates(0,0,2000); Vector.ZAxis(); }
byStartPointEndPoint_5 = AdvanceSteel.Nodes.Beams.StraightBeam.ByStartPointEndPoint(code_block_10.out0, code_block_10.out1, code_block_10.out2)
code_block_11 = CodeBlock { "AISC Angle equal"; "L4X4X7/16"; }
createSectionString_7 = AdvanceSteel.Nodes.Util.BeamSection.CreateSectionString(code_block_11.out0, code_block_11.out1)
setSection_5 = AdvanceSteel.Nodes.Util.BeamSection.SetSection(byStartPointEndPoint_5, createSectionString_7)
code_block_12 = CodeBlock { Point.ByCoordinates(0,0,0); Point.ByCoordinates(0,2000,0); Vector.ZAxis(); }
code_block_13 = CodeBlock { "Compound2UToe"; "Default CISC"; }
createSectionString_8 = AdvanceSteel.Nodes.Util.BeamSection.CreateSectionString(code_block_13.out0, code_block_13.out1)
byStartPointEndPoint_6 = AdvanceSteel.Nodes.Beams.CompoundBeam.ByStartPointEndPoint(code_block_12.out0, code_block_12.out1, code_block_12.out2, createSectionString_8)
code_block_14 = CodeBlock { "Compound2U"; "Default"; }
createSectionString_9 = AdvanceSteel.Nodes.Util.BeamSection.CreateSectionString(code_block_14.out0, code_block_14.out1)
setSection_6 = AdvanceSteel.Nodes.Util.BeamSection.SetSection(byStartPointEndPoint_6, createSectionString_9)
