# Dynamo graph Circus.dyn (Dynamo 1.0.0.1531)

# group: Input values
x_coordinate = CodeBlock { 0; }
y_coordinate = CodeBlock { 0; }
z_coordinate = CodeBlock { 0; }
top_radius = DoubleInput(12000)
column_height = DoubleInput(3500)
divisions = DoubleInput(20)
base_radius = DoubleInput(13000)

byCoordinates = Point.ByCoordinates(x=x_coordinate, y=y_coordinate, z=z_coordinate)
byCenterPointRadius = Circle.ByCenterPointRadius(centerPoint=byCoordinates, radius=top_radius)
byCoordinates_2 = Vector.ByCoordinates(z=column_height)
translate = Geometry.Translate(geometry=byCenterPointRadius, direction=byCoordinates_2)
divisions_2 = CodeBlock(x=divisions) { x; }
pointsAtEqualSegmentLength = Curve.PointsAtEqualSegmentLength(curve=translate, divisions=divisions_2)
splitByPoints = Curve.SplitByPoints(curve=translate, points=pointsAtEqualSegmentLength)

# group: Roof Beams
startPoint = Curve.StartPoint(splitByPoints)
centerPoint = Circle.CenterPoint(translate)
roof_height = DoubleInput(4000)
byCoordinates_3 = Vector.ByCoordinates(z=roof_height)
translate_2 = Geometry.Translate(geometry=centerPoint, direction=byCoordinates_3)
ZAxis = Vector.ZAxis()
byStartPointEndPoint = AdvanceSteel.Nodes.Beams.StraightBeam.ByStartPointEndPoint(startPoint, translate_2, ZAxis)
code_block = CodeBlock { 1; "Roof beam"; }
setUserAttribute = AdvanceSteel.Nodes.Util.UserAttribute.SetUserAttribute(byStartPointEndPoint, code_block.out0, code_block.out1)

# group: Bent Beams
bent_beams = CodeBlock(curve=splitByPoints) { curve; }
startPoint_2 = Curve.StartPoint(bent_beams)
endPoint = Curve.EndPoint(bent_beams)
middle_of_curve = CodeBlock { 0.5; }
pointAtParameter = Curve.PointAtParameter(curve=bent_beams, param=middle_of_curve)
ZAxis_2 = Vector.ZAxis()
byStartPointEndPoint_2 = AdvanceSteel.Nodes.Beams.BentBeam.ByStartPointEndPoint(startPoint_2, endPoint, pointAtParameter, ZAxis_2)
code_block_2 = CodeBlock { 1; "Bent beam"; }
setUserAttribute_2 = AdvanceSteel.Nodes.Util.UserAttribute.SetUserAttribute(byStartPointEndPoint_2, code_block_2.out0, code_block_2.out1)

byCenterPointRadius_2 = Circle.ByCenterPointRadius(centerPoint=byCoordinates, radius=base_radius)

# group: Columns
pointsAtEqualSegmentLength_2 = Curve.PointsAtEqualSegmentLength(curve=byCenterPointRadius_2, divisions=divisions_2)
splitByPoints_2 = Curve.SplitByPoints(curve=byCenterPointRadius_2, points=pointsAtEqualSegmentLength_2)
startPoint_3 = Curve.StartPoint(splitByPoints_2)
startPoint_4 = Curve.StartPoint(splitByPoints)
code_block_3 = CodeBlock { 0; }
normalAtParameter = Curve.NormalAtParameter(curve=splitByPoints_2, param=code_block_3)
byStartPointEndPoint_3 = AdvanceSteel.Nodes.Beams.StraightBeam.ByStartPointEndPoint(startPoint_3, startPoint_4, normalAtParameter)
code_block_4 = CodeBlock { 1; "Column"; }
setUserAttribute_3 = AdvanceSteel.Nodes.Util.UserAttribute.SetUserAttribute(byStartPointEndPoint_3, code_block_4.out0, code_block_4.out1)
