# Dynamo graph Dome.dyn (Dynamo 1.0.0.1531)

# group: Input Surface
code_block = CodeBlock { Point.ByCoordinates(0,0,0); }
radius = DoubleSlider(15000, range=0..20000 step 0.1)
code_block_2 = CodeBlock { 0; 85; 360; }
XAxis = Vector.XAxis()
byCenterPointRadiusAngle = Arc.ByCenterPointRadiusAngle(center=code_block, radius=radius, startAngle=code_block_2.out0, endAngle=code_block_2.out1, normal=XAxis)
ZAxis = Vector.ZAxis()
byRevolve = Surface.ByRevolve(byCenterPointRadiusAngle, arg2=ZAxis, arg4=code_block_2.out2)

# group: Triangulate surface with Advance Steel Plates and Beams
code_block_3 = CodeBlock(surface=byRevolve) { surface; }
mesh_parameters = CodeBlock { 150; 25; }
# note: You need to have Dynamo Mesh Toolkit in order to use this sample. To install, select "Search for a Package" from the Packages menu, and search for MeshToolkit.
byGeometry = Autodesk.Dynamo.MeshToolkit.Mesh.ByGeometry(code_block_3, mesh_parameters.out0, mesh_parameters.out1)
triangles = Autodesk.Dynamo.MeshToolkit.Mesh.Triangles(byGeometry)
perimeterCurves = Surface.PerimeterCurves(triangles)
endPoint = Curve.EndPoint(perimeterCurves)
byPoints = Polygon.ByPoints(endPoint)
byPolygon = AdvanceSteel.Nodes.Plates.Plate.ByPolygon(byPoints)
edges = Autodesk.Dynamo.MeshToolkit.Mesh.Edges(byGeometry)
startPoint = Curve.StartPoint(edges)
endPoint_2 = Curve.EndPoint(edges)
code_block_4 = CodeBlock { 0.5; }
pointAtParameter = Curve.PointAtParameter(curve=edges, param=code_block_4)
normalAtPoint = Surface.NormalAtPoint(surface=code_block_3, point=pointAtParameter)
byStartPointEndPoint = AdvanceSteel.Nodes.Beams.StraightBeam.ByStartPointEndPoint(startPoint, endPoint_2, normalAtPoint)

# group: UserAttibutes
code_block_5 = CodeBlock { 1; "Glass"; "Pipe"; }
setUserAttribute = AdvanceSteel.Nodes.Util.UserAttribute.SetUserAttribute(byPolygon, code_block_5.out0, code_block_5.out1)
setUserAttribute_2 = AdvanceSteel.Nodes.Util.UserAttribute.SetUserAttribute(byStartPointEndPoint, code_block_5.out0, code_block_5.out2)
