# Dynamo graph PortalFrame.dyn (Dynamo 1.0.0.1531)

number = DoubleInput(0)

# group: Input values
number_of_frames = IntegerSlider(8, range=0..12 step 1)
distance_between_frames = DoubleInput(6000)
column_height = DoubleInput(4500)
span = DoubleInput(10000)
roof_height = DoubleInput(1500)
number_of_purlins = DoubleInput(8)
number_of_bays_between_bracings = DoubleInput(2)

sequence = Sequence(start=number, amount=number_of_frames, step=distance_between_frames, lacing=Longest)
byCoordinates = Point.ByCoordinates(x=sequence, z=column_height)
byCoordinates_2 = Point.ByCoordinates(x=sequence)
byStartPointEndPoint = Line.ByStartPointEndPoint(startPoint=byCoordinates, endPoint=byCoordinates_2)
YAxis = Vector.YAxis()
span_2 = DoubleInput(x, span, lacing=Longest)
scale = Vector.Scale(vector=YAxis, scale_factor=span_2)
translate = Geometry.Translate(geometry=byStartPointEndPoint, direction=scale)
endPoint = Curve.EndPoint(translate)
pointsBaseLeft = CodeBlock(x=endPoint) { x; }
startPoint = Curve.StartPoint(translate)
pointsRoofLeft = CodeBlock(x=startPoint) { x; }
pointsBaseRight = CodeBlock(x=byCoordinates_2) { x; }
pointsRoofRight = CodeBlock(x=byCoordinates) { x; }

# group: Columns
YAxis_2 = Vector.YAxis()
byStartPointEndPoint_2 = AdvanceSteel.Nodes.Beams.StraightBeam.ByStartPointEndPoint(pointsBaseLeft, pointsRoofLeft, YAxis_2)
code_block = CodeBlock { 1; "HEA320"; }
setUserAttribute = AdvanceSteel.Nodes.Util.UserAttribute.SetUserAttribute(byStartPointEndPoint_2, code_block.out0, code_block.out1)
byStartPointEndPoint_3 = AdvanceSteel.Nodes.Beams.StraightBeam.ByStartPointEndPoint(pointsBaseRight, pointsRoofRight, YAxis_2)
code_block_2 = CodeBlock { 1; "HEA320"; }
setUserAttribute_2 = AdvanceSteel.Nodes.Util.UserAttribute.SetUserAttribute(byStartPointEndPoint_3, code_block_2.out0, code_block_2.out1)

formula = Formula("x/2", x=span_2)
roof_height_2 = DoubleInput(x, roof_height, lacing=Longest)
byCoordinates_3 = Vector.ByCoordinates(y=formula, z=roof_height_2)
translate_2 = Geometry.Translate(geometry=byCoordinates, direction=byCoordinates_3)
pointsRoofCenter = CodeBlock(x=translate_2) { x; }

# group: Rafter beams
ZAxis = Vector.ZAxis()
byStartPointEndPoint_4 = AdvanceSteel.Nodes.Beams.StraightBeam.ByStartPointEndPoint(pointsRoofRight, pointsRoofCenter, ZAxis)
code_block_3 = CodeBlock { 1; "IPE400"; }
setUserAttribute_3 = AdvanceSteel.Nodes.Util.UserAttribute.SetUserAttribute(byStartPointEndPoint_4, code_block_3.out0, code_block_3.out1)
byStartPointEndPoint_5 = AdvanceSteel.Nodes.Beams.StraightBeam.ByStartPointEndPoint(pointsRoofLeft, pointsRoofCenter, ZAxis)
code_block_4 = CodeBlock { 1; "IPE400"; }
setUserAttribute_4 = AdvanceSteel.Nodes.Util.UserAttribute.SetUserAttribute(byStartPointEndPoint_5, code_block_4.out0, code_block_4.out1)

# group: Eaves beams
pointsRoofRight_2 = CodeBlock(x=pointsRoofRight) { x; }
count = List.Count(pointsRoofRight_2)
code_block_5 = CodeBlock(x=count) { 0..x-2; }
getItemAtIndex = List.GetItemAtIndex(list=pointsRoofRight_2, index=code_block_5)
code_block_6 = CodeBlock(x=count) { 1..x-1; }
getItemAtIndex_2 = List.GetItemAtIndex(list=pointsRoofRight_2, index=code_block_6)
ZAxis_2 = Vector.ZAxis()
byStartPointEndPoint_6 = AdvanceSteel.Nodes.Beams.StraightBeam.ByStartPointEndPoint(getItemAtIndex, getItemAtIndex_2, ZAxis_2)
code_block_7 = CodeBlock { 1; "IPE200"; }
setUserAttribute_5 = AdvanceSteel.Nodes.Util.UserAttribute.SetUserAttribute(byStartPointEndPoint_6, code_block_7.out0, code_block_7.out1)
pointsRoofLeft_2 = CodeBlock(x=pointsRoofLeft) { x; }
count_2 = List.Count(pointsRoofLeft_2)
code_block_8 = CodeBlock(x=count_2) { 0..x-2; }
getItemAtIndex_3 = List.GetItemAtIndex(list=pointsRoofLeft_2, index=code_block_8)
code_block_9 = CodeBlock(x=count_2) { 1..x-1; }
getItemAtIndex_4 = List.GetItemAtIndex(list=pointsRoofLeft_2, index=code_block_9)
ZAxis_3 = Vector.ZAxis()
byStartPointEndPoint_7 = AdvanceSteel.Nodes.Beams.StraightBeam.ByStartPointEndPoint(getItemAtIndex_3, getItemAtIndex_4, ZAxis_3)
code_block_10 = CodeBlock { 1; "IPE200"; }
setUserAttribute_6 = AdvanceSteel.Nodes.Util.UserAttribute.SetUserAttribute(byStartPointEndPoint_7, code_block_10.out0, code_block_10.out1)

# group: Purlins
pointsRoofRight_3 = CodeBlock(x=pointsRoofRight) { x; }
code_block_11 = CodeBlock(x=pointsRoofRight_3) { x[0]; }
pointsRoofCenter_2 = CodeBlock(x=pointsRoofCenter) { x; }
code_block_12 = CodeBlock(x=pointsRoofCenter_2) { x[0]; }
byTwoPoints = Vector.ByTwoPoints(start=code_block_11, end=code_block_12)
normalized = Vector.Normalized(byTwoPoints)
eaves_offset = CodeBlock { 350; }
translate_3 = Geometry.Translate(geometry=pointsRoofRight_3, direction=normalized, distance=eaves_offset)
reverse = Vector.Reverse(normalized)
apex_offset = CodeBlock { 250; }
translate_4 = Geometry.Translate(geometry=pointsRoofCenter_2, direction=reverse, distance=apex_offset)
byStartPointEndPoint_8 = Line.ByStartPointEndPoint(startPoint=translate_3, endPoint=translate_4)
purlins = CodeBlock(x=number_of_purlins) { x; }
code_block_13 = CodeBlock(x=purlins) { x; }
pointsAtEqualSegmentLength = Curve.PointsAtEqualSegmentLength(curve=byStartPointEndPoint_8, divisions=code_block_13)
splitByPoints = Curve.SplitByPoints(curve=byStartPointEndPoint_8, points=pointsAtEqualSegmentLength)
endPoint_2 = Curve.EndPoint(splitByPoints)
flatten = Flatten(endPoint_2)
chop = List.Chop(list=flatten, lengths=code_block_13)
count_3 = List.Count(chop)
code_block_14 = CodeBlock(x=count_3) { 0..x-2..1; }
getItemAtIndex_5 = List.GetItemAtIndex(list=chop, index=code_block_14)
code_block_15 = CodeBlock(x=count_3) { 1..x-1..1; }
getItemAtIndex_6 = List.GetItemAtIndex(list=chop, index=code_block_15)
code_block_16 = CodeBlock { 0; }
getItemAtIndex_7 = List.GetItemAtIndex(list=byStartPointEndPoint_8, index=code_block_16)
endPoint_3 = Curve.EndPoint(getItemAtIndex_7)
startPoint_2 = Curve.StartPoint(getItemAtIndex_7)
byTwoPoints_2 = Vector.ByTwoPoints(start=endPoint_3, end=startPoint_2)
XAxis = Vector.XAxis()
cross = Vector.Cross(vector=byTwoPoints_2, cross=XAxis)
byStartPointEndPoint_9 = AdvanceSteel.Nodes.Beams.StraightBeam.ByStartPointEndPoint(getItemAtIndex_5, getItemAtIndex_6, cross)
code_block_17 = CodeBlock { 1; "Z200"; }
setUserAttribute_7 = AdvanceSteel.Nodes.Util.UserAttribute.SetUserAttribute(byStartPointEndPoint_9, code_block_17.out0, code_block_17.out1)
pointsRoofLeft_3 = CodeBlock(x=pointsRoofLeft) { x; }
code_block_18 = CodeBlock(x=pointsRoofLeft_3) { x[0]; }
pointsRoofCenter_3 = CodeBlock(x=pointsRoofCenter) { x; }
code_block_19 = CodeBlock(x=pointsRoofCenter_3) { x[0]; }
byTwoPoints_3 = Vector.ByTwoPoints(start=code_block_18, end=code_block_19)
normalized_2 = Vector.Normalized(byTwoPoints_3)
eaves_offset_2 = CodeBlock { 350; }
translate_5 = Geometry.Translate(geometry=pointsRoofLeft_3, direction=normalized_2, distance=eaves_offset_2)
reverse_2 = Vector.Reverse(normalized_2)
apex_offset_2 = CodeBlock { 250; }
translate_6 = Geometry.Translate(geometry=pointsRoofCenter_3, direction=reverse_2, distance=apex_offset_2)
byStartPointEndPoint_10 = Line.ByStartPointEndPoint(startPoint=translate_5, endPoint=translate_6)
code_block_20 = CodeBlock(x=purlins) { x; }
pointsAtEqualSegmentLength_2 = Curve.PointsAtEqualSegmentLength(curve=byStartPointEndPoint_10, divisions=code_block_20)
splitByPoints_2 = Curve.SplitByPoints(curve=byStartPointEndPoint_10, points=pointsAtEqualSegmentLength_2)
endPoint_4 = Curve.EndPoint(splitByPoints_2)
flatten_2 = Flatten(endPoint_4)
chop_2 = List.Chop(list=flatten_2, lengths=code_block_20)
count_4 = List.Count(chop_2)
code_block_21 = CodeBlock(x=count_4) { 0..x-2..1; }
getItemAtIndex_8 = List.GetItemAtIndex(list=chop_2, index=code_block_21)
code_block_22 = CodeBlock(x=count_4) { 1..x-1..1; }
getItemAtIndex_9 = List.GetItemAtIndex(list=chop_2, index=code_block_22)
code_block_23 = CodeBlock { 0; }
getItemAtIndex_10 = List.GetItemAtIndex(list=byStartPointEndPoint_10, index=code_block_23)
endPoint_5 = Curve.EndPoint(getItemAtIndex_10)
startPoint_3 = Curve.StartPoint(getItemAtIndex_10)
byTwoPoints_4 = Vector.ByTwoPoints(start=endPoint_5, end=startPoint_3)
XAxis_2 = Vector.XAxis()
cross_2 = Vector.Cross(vector=byTwoPoints_4, cross=XAxis_2)
byStartPointEndPoint_11 = AdvanceSteel.Nodes.Beams.StraightBeam.ByStartPointEndPoint(getItemAtIndex_8, getItemAtIndex_9, cross_2)
code_block_24 = CodeBlock { 1; "Z200"; }
setUserAttribute_8 = AdvanceSteel.Nodes.Util.UserAttribute.SetUserAttribute(byStartPointEndPoint_11, code_block_24.out0, code_block_24.out1)
listOfPoints = CodeBlock(x=translate_3) { x; }
count_5 = List.Count(listOfPoints)
code_block_25 = CodeBlock(x=count_5) { 0..x-2; }
getItemAtIndex_11 = List.GetItemAtIndex(list=listOfPoints, index=code_block_25)
code_block_26 = CodeBlock(x=count_5) { 1..x-1; }
getItemAtIndex_12 = List.GetItemAtIndex(list=listOfPoints, index=code_block_26)
byStartPointEndPoint_12 = AdvanceSteel.Nodes.Beams.StraightBeam.ByStartPointEndPoint(getItemAtIndex_11, getItemAtIndex_12, cross)
code_block_27 = CodeBlock { 1; "Z200"; }
setUserAttribute_9 = AdvanceSteel.Nodes.Util.UserAttribute.SetUserAttribute(byStartPointEndPoint_12, code_block_27.out0, code_block_27.out1)
listOfPoints_2 = CodeBlock(x=translate_5) { x; }
count_6 = List.Count(listOfPoints_2)
code_block_28 = CodeBlock(x=count_6) { 0..x-2; }
getItemAtIndex_13 = List.GetItemAtIndex(list=listOfPoints_2, index=code_block_28)
code_block_29 = CodeBlock(x=count_6) { 1..x-1; }
getItemAtIndex_14 = List.GetItemAtIndex(list=listOfPoints_2, index=code_block_29)
byStartPointEndPoint_13 = AdvanceSteel.Nodes.Beams.StraightBeam.ByStartPointEndPoint(getItemAtIndex_13, getItemAtIndex_14, cross_2)
code_block_30 = CodeBlock { 1; "Z200"; }
setUserAttribute_10 = AdvanceSteel.Nodes.Util.UserAttribute.SetUserAttribute(byStartPointEndPoint_13, code_block_30.out0, code_block_30.out1)

# group: Bracings
pointsRoofRight_4 = CodeBlock(x=byCoordinates) { x; }
code_block_31 = CodeBlock { 0; }
code_block_32 = CodeBlock(x=number_of_frames) { x-2; }
code_block_33 = CodeBlock(y=number_of_bays_between_bracings) { y+1; }
range = Range(start=code_block_31, end=code_block_32, step=code_block_33, lacing=Longest)
code_block_34 = CodeBlock(x=range) { x+0; x+1; }
getItemAtIndex_15 = List.GetItemAtIndex(list=pointsRoofRight_4, index=code_block_34.out1)
pointsBaseRight_2 = CodeBlock(x=byCoordinates_2) { x; }
getItemAtIndex_16 = List.GetItemAtIndex(list=pointsBaseRight_2, index=code_block_34.out0)
YAxis_3 = Vector.YAxis()
byStartPointEndPoint_14 = AdvanceSteel.Nodes.Beams.StraightBeam.ByStartPointEndPoint(getItemAtIndex_15, getItemAtIndex_16, YAxis_3)
code_block_35 = CodeBlock { 1; "RHS100x10"; }
setUserAttribute_11 = AdvanceSteel.Nodes.Util.UserAttribute.SetUserAttribute(byStartPointEndPoint_14, code_block_35.out0, code_block_35.out1)
getItemAtIndex_17 = List.GetItemAtIndex(list=pointsRoofRight_4, index=code_block_34.out0)
getItemAtIndex_18 = List.GetItemAtIndex(list=pointsBaseRight_2, index=code_block_34.out1)
YAxis_4 = Vector.YAxis()
byStartPointEndPoint_15 = AdvanceSteel.Nodes.Beams.StraightBeam.ByStartPointEndPoint(getItemAtIndex_17, getItemAtIndex_18, YAxis_4)
code_block_36 = CodeBlock { 1; "RHS100x10"; }
setUserAttribute_12 = AdvanceSteel.Nodes.Util.UserAttribute.SetUserAttribute(byStartPointEndPoint_15, code_block_36.out0, code_block_36.out1)
pointsRoofLeft_4 = CodeBlock(x=pointsRoofLeft) { x; }
range_2 = Range(start=code_block_31, end=code_block_32, step=code_block_33, lacing=Longest)
code_block_37 = CodeBlock(x=range_2) { x+0; x+1; }
getItemAtIndex_19 = List.GetItemAtIndex(list=pointsRoofLeft_4, index=code_block_37.out1)
pointsBaseLeft_2 = CodeBlock(x=pointsBaseLeft) { x; }
getItemAtIndex_20 = List.GetItemAtIndex(list=pointsBaseLeft_2, index=code_block_37.out0)
YAxis_5 = Vector.YAxis()
byStartPointEndPoint_16 = AdvanceSteel.Nodes.Beams.StraightBeam.ByStartPointEndPoint(getItemAtIndex_19, getItemAtIndex_20, YAxis_5)
code_block_38 = CodeBlock { 1; "RHS100x10"; }
setUserAttribute_13 = AdvanceSteel.Nodes.Util.UserAttribute.SetUserAttribute(byStartPointEndPoint_16, code_block_38.out0, code_block_38.out1)
getItemAtIndex_21 = List.GetItemAtIndex(list=pointsRoofLeft_4, index=code_block_37.out0)
getItemAtIndex_22 = List.GetItemAtIndex(list=pointsBaseLeft_2, index=code_block_37.out1)
YAxis_6 = Vector.YAxis()
byStartPointEndPoint_17 = AdvanceSteel.Nodes.Beams.StraightBeam.ByStartPointEndPoint(getItemAtIndex_21, getItemAtIndex_22, YAxis_6)
code_block_39 = CodeBlock { 1; "RHS100x10"; }
setUserAttribute_14 = AdvanceSteel.Nodes.Util.UserAttribute.SetUserAttribute(byStartPointEndPoint_17, code_block_39.out0, code_block_39.out1)
