# Dynamo graph Selection.dyn (Dynamo 2.5.2.7915)

selectSteelObjects = ASObjectSelection()  # 10 picked in the model
advance_steel_object_types = ASObjecTypes("Advance Steel Straight Beam")
list_create = List.Create(item0=advance_steel_object_types)
filterSelectionByType = AdvanceSteel.Nodes.Selection.ObjectSelection.FilterSelectionByType(currentSelectionSet=selectSteelObjects, objectTypeFilters=list_create)
advance_steel_object_types_2 = ASObjecTypes("Advance Steel Plate")
list_create_2 = List.Create(item0=advance_steel_object_types_2)
filterSelectionByType_2 = AdvanceSteel.Nodes.Selection.ObjectSelection.FilterSelectionByType(currentSelectionSet=selectSteelObjects, objectTypeFilters=list_create_2)
advance_steel_object_types_3 = ASObjecTypes("Advance Steel Bent Beam")
list_create_3 = List.Create(item0=advance_steel_object_types_3)
filterSelectionByType_3 = AdvanceSteel.Nodes.Selection.ObjectSelection.FilterSelectionByType(currentSelectionSet=selectSteelObjects, objectTypeFilters=list_create_3)
