# Dynamo graph ShearStuds.dyn (Dynamo 2.5.2.7915)

code_block = CodeBlock()
# ---------- code_block.designscript (3 lines) ----------
CoordinateSystem.ByOriginVectors(Point.ByCoordinates(1500,0,0), Vector.XAxis(), Vector.YAxis(), Vector.ZAxis());
Point.ByCoordinates(1500,0,0);
Vector.ZAxis();
# ----------------------------------------
byOriginNormal = Plane.ByOriginNormal(origin=code_block.out1, normal=code_block.out2)
code_block_2 = CodeBlock { 300; 300; }
byWidthLength = Rectangle.ByWidthLength(plane=byOriginNormal, width=code_block_2.out0, length=code_block_2.out1)
code_block_3 = CodeBlock { 500; 650; 20; 0; -1; 1; }
byRectanglarByCS = AdvanceSteel.Nodes.Plates.Plate.ByRectanglarByCS(coordinateSystem=code_block.out0, length=code_block_3.out0, width=code_block_3.out1, thickness=code_block_3.out2, side=code_block_3.out3, corner=code_block_3.out4)
code_block_4 = CodeBlock { "Nelson S3L"; "Mild Steel"; 22; 150; }
code_block_5 = CodeBlock { 20; 3; 4; 150; 200; }
weld_connection_type = WeldConnectionType("InShop")
code_block_6 = CodeBlock { false; true; }
shearStuds = AdvanceSteel.Nodes.Util.BuildPropertyCollection.ShearStuds(standard=code_block_4.out0, grade=code_block_4.out1, diameter=code_block_4.out2, length=code_block_4.out3, xHoleCount=code_block_5.out1, yHoleCount=code_block_5.out2, shearStudConType=weld_connection_type, displayAsSolid=code_block_6.out1)
byRectangle = AdvanceSteel.Nodes.ConnectionObjects.ShearStuds.RectangularShearStudsPattern.ByRectangle(rectangle=byWidthLength, objectToConnect=byRectanglarByCS, shearStudData=shearStuds)
code_block_7 = CodeBlock()
# ---------- code_block_7.designscript (3 lines) ----------
CoordinateSystem.ByOriginVectors(Point.ByCoordinates(0,0,0), Vector.XAxis(), Vector.YAxis(), Vector.ZAxis());
Point.ByCoordinates(0,0,0);
Vector.ZAxis();
# ----------------------------------------
code_block_8 = CodeBlock { 500; 500; 20; 0; -1; 1; }
byRectanglarByCS_2 = AdvanceSteel.Nodes.Plates.Plate.ByRectanglarByCS(coordinateSystem=code_block_7.out0, length=code_block_8.out0, width=code_block_8.out1, thickness=code_block_8.out2, side=code_block_8.out3, corner=code_block_8.out4)
code_block_9 = CodeBlock { "Nelson S3L"; "Mild Steel"; 22; 150; }
code_block_10 = CodeBlock { 20; 3; 4; 200; 200; }
weld_connection_type_2 = WeldConnectionType("InShop")
code_block_11 = CodeBlock { false; true; }
shearStuds_2 = AdvanceSteel.Nodes.Util.BuildPropertyCollection.ShearStuds(standard=code_block_9.out0, grade=code_block_9.out1, diameter=code_block_9.out2, length=code_block_9.out3, xHoleCount=code_block_10.out1, yHoleCount=code_block_10.out2, xHoleSpacing=code_block_10.out3, yHoleSpacing=code_block_10.out4, shearStudConType=weld_connection_type_2, displayAsSolid=code_block_11.out1)
atCentrePoint = AdvanceSteel.Nodes.ConnectionObjects.ShearStuds.RectangularShearStudsPattern.AtCentrePoint(connectionPoint=code_block_7.out1, shearStudCS=code_block_7.out0, objectToConnect=byRectanglarByCS_2, shearStudData=shearStuds_2)
code_block_12 = CodeBlock()
# ---------- code_block_12.designscript (3 lines) ----------
CoordinateSystem.ByOriginVectors(Point.ByCoordinates(0,1500,0), Vector.XAxis(), Vector.YAxis(), Vector.ZAxis());
Point.ByCoordinates(0,1500,0);
Vector.ZAxis();
# ----------------------------------------
code_block_13 = CodeBlock { 150; }
byCenterPointRadiusNormal = Circle.ByCenterPointRadiusNormal(centerPoint=code_block_12.out1, radius=code_block_13, normal=code_block_12.out2)
code_block_14 = CodeBlock { Vector.XAxis(); }
code_block_15 = CodeBlock { 500; 500; 20; 0; -1; 1; }
byRectanglarByCS_3 = AdvanceSteel.Nodes.Plates.Plate.ByRectanglarByCS(coordinateSystem=code_block_12.out0, length=code_block_15.out0, width=code_block_15.out1, thickness=code_block_15.out2, side=code_block_15.out3, corner=code_block_15.out4)
code_block_16 = CodeBlock { "Nelson S3L"; "Mild Steel"; 22; 150; }
code_block_17 = CodeBlock { 20; 6; 4; 200; 200; }
weld_connection_type_3 = WeldConnectionType("InShop")
code_block_18 = CodeBlock { false; true; }
shearStuds_3 = AdvanceSteel.Nodes.Util.BuildPropertyCollection.ShearStuds(standard=code_block_16.out0, grade=code_block_16.out1, diameter=code_block_16.out2, length=code_block_16.out3, xHoleCount=code_block_17.out1, yHoleCount=code_block_17.out1, shearStudConType=weld_connection_type_3, displayAsSolid=code_block_18.out1)
byCircle = AdvanceSteel.Nodes.ConnectionObjects.ShearStuds.CircularShearStudsPattern.ByCircle(circle=byCenterPointRadiusNormal, referenceVector=code_block_14, objectToConnect=byRectanglarByCS_3, shearStudData=shearStuds_3)
